# Grasshopper definition assignment-01.gh (Grasshopper 1.0.8)

# Assignment-01: Bauhaus
number_slider = Slider(1, range=0..1)
py3 = Python3Script(x=Slider(1, range=0..1), y=number_slider)  # -> out, a
# ---------- py3: Python ----------
import Rhino.Geometry as rg
import cdf.geometry_basics as gb
import importlib

importlib.reload(gb)

radius = x
box_height = y
print("Radius:", radius)
print("Box height:", box_height)
center = rg.Point3d(0, 0, box_height + radius)

a = gb.create_sphere(center_point=center, radius=radius)
# ---------- end py3 ----------
py3_2 = Python3Script(x=number_slider)  # -> out, a
# ---------- py3_2: Python ----------
import cdf.geometry_basics as gb
import importlib

importlib.reload(gb)

a = gb.create_box(width=10, depth=10, height=x)
# ---------- end py3_2 ----------
