# Grasshopper definition assignment-01_Annika.gh (Grasshopper 1.0.8)

compactness = Slider(1, range=0..1)
radius = Slider(3.4, range=1..5)
count = Slider(20, range=0..20)
phase = Slider(3, range=0..4)
# Assignment-01: Bauhaus
max_size = Slider(6, range=0..20)
seed = Slider(14, range=0..20)
py3 = Python3Script(max_size=max_size, count=count, seed=seed, phase=phase, radius=radius, compactness=compactness)  # -> out, a, b, k, l
# ---------- py3: Python ----------
"""Grasshopper Python 3 | Bauhaus v12

5 INPUTS (Slider links):
  max_size  float  > 0 (z.B. 10)
  count     int     1..80 (z.B. 8)
  seed      int     0..999 (z.B. 1)
  radius    float   0.5..5.0 (z.B. 2.5)
  phase     int     0..4 (z.B. 1)

OUTPUTS (Namen a bis n auf der Komponente beibehalten):
  a: Angezeigte Breps             -> Custom Preview G
  b: Gedämpfte Bauhaus-Farben -> Custom Preview M (oder Create Material Kd)
  c: Finale Elemente + Achse + Sockel (Phase 3)
  d: Farben zu c
  e: Achse (Kurve) der Phase 3
  f: Referenzquader
  g: Namen der Phasen
  h: Metadaten
  i: schwarzer Achszylinder der Phase 3
  j: Achsenfarbe
  k: Beruehrpunkte der aktuell angezeigten Phase
  l: Verbindungslinien der aktuell angezeigten Phase
  m: Sockelquader der Phase 3
  n: Sockelfarbe

WICHTIG: Kein importlib.reload bei jeder Berechnung! So bleibt der
Geometrie-Cache aktiv und phase-Wechsel laufen ohne Neuaufbau.
Der Wrapper aktualisiert eine aeltere Modulversion einmalig auf v12.
Bei spaeteren Aenderungen INNERHALB von v12 einmal manuell reloaden.
"""
from cdf import bauhaus_axis_composition as bauhaus

# Reload NUR beim Wechsel auf v12, danach bleibt der Geometrie-Cache erhalten.
if getattr(bauhaus, "VERSION", None) != "12":
    import importlib
    bauhaus = importlib.reload(bauhaus)

model = bauhaus.create_bauhaus_axis_composition(
    max_size=max_size,
    count=count,
    seed=seed,
    radius=radius,
)
state = bauhaus.get_display_state(model, phase=phase)
final = model["stages"][3]

a = state["display_geometry"]
b = state["display_materials"]
c = final["geometries"] + [final["axis_solid"],final["base_solid"]]
d = model["materials"] + [model["axis_material"],model["base_material"]]
e = final["axis_curve"]
f = model["stages"][0]["geometries"]
g = list(model["step_names"])
h = model["metadata"]
i = final["axis_solid"]
j = model["axis_material"]
k = state["contact_points"]
l = state["contact_lines"]
m = final["base_solid"]
n = model["base_material"]
# ---------- end py3 ----------

# ---- group: Auto-reloads cdf module on VScode changes
# Setting path for Src AutoReloader: 1. Right click on Path
# 2. Choose "Select a directory"
# 3. Locate the ..\cdf1_teaching\src folder in your computer
path = FilePath("C:\Annika Kiessling\Workspace\cdf1_teaching\src\")
autoreloader = Python3Script(src_path=path)  # -> out; inputs src_path: String
# ---------- autoreloader: Python ----------
#! python3
import sys, os, time
import scriptcontext as sc
import Rhino, System
from System.IO import FileSystemWatcher, NotifyFilters

VERSION = 1  
pkg = "cdf"

if not src_path:
    raise Exception("Connect a folder to src_path.")
path = os.path.normpath(src_path)
watch_dir = os.path.join(path, pkg)
if not os.path.isdir(watch_dir):
    raise Exception("No '{}' folder found in:\n{}".format(pkg, path))

def unload():
    for name in list(sys.modules):
        if name == pkg or name.startswith(pkg + "."):
            del sys.modules[name]

# Put this folder first in Python's search list
if path in sys.path:
    sys.path.remove(path)
sys.path.insert(0, path)

key = "cdf_watcher_" + str(ghenv.Component.InstanceGuid)
time_key = key + "_time"
version_key = key + "_version"

def stamp():
    sc.sticky[time_key] = time.strftime("%Y-%m-%d %H:%M:%S")

# Replace the old watcher if the folder changed or the script was updated
old = sc.sticky.get(key)
if old is not None and (os.path.normpath(old.Path) != watch_dir
                        or sc.sticky.get(version_key) != VERSION):
    old.Dispose()
    del sc.sticky[key]
    unload()

if key not in sc.sticky:
    comp = ghenv.Component
    last = [0.0]

    def reload_and_rerun():
        unload()
        stamp()
        doc = comp.OnPingDocument()
        if doc is None:            # reloader was deleted or the file closed
            return
        for obj in doc.Objects:
            if "Python" in obj.GetType().Name:
                obj.ExpireSolution(False)   # mark as out of date
        doc.NewSolution(False)              # recompute once

    def on_change(sender, e):
        if not e.FullPath.endswith(".py") or "__pycache__" in e.FullPath:
            return
        if time.time() - last[0] < 0.5:     # ignore the second event of a double save
            return
        last[0] = time.time()
        Rhino.RhinoApp.InvokeOnUiThread(System.Action(reload_and_rerun))

    w = FileSystemWatcher(watch_dir, "*.py")
    w.IncludeSubdirectories = True
    w.NotifyFilter = NotifyFilters.LastWrite
    w.Changed += on_change
    w.EnableRaisingEvents = True
    sc.sticky[key] = w
    sc.sticky[version_key] = VERSION
    stamp()                                  # time the watcher started

msg = "Last reloaded: {}\nWatching: {}".format(sc.sticky.get(time_key, "unknown"), watch_dir)
print(msg)
out = msg
# ---------- end autoreloader ----------
panel = Panel(autoreloader)

# ----
crv = Curve(py3.l)
pt = Point(py3.k)
preview = CustomPreview(Geometry=py3.a, Material=py3.b)
