# Grasshopper definition assignment-01_backup.gh (Grasshopper 1.0.8)

# Assignment-01: Bauhaus
offset = Slider(5, range=-5..5)
radius = Slider(1, range=0..1)
x = Slider(2, range=0..10)
plane = Slider(0.089, range=0..1)
height = Slider(6, range=0..10)
sphere = Python3Script(radius=x, y=x, a=Slider(2, range=0..10))  # -> out, a
# ---------- sphere: Python ----------
import Rhino.Geometry as rg

center = rg.Point3d(0, 0, y + radius)
sphere = rg.Sphere(center, radius)
a = sphere.ToBrep()
# ---------- end sphere ----------
cone = Python3Script(plane=plane, y=x, height=height, x=x)  # -> out, a
# ---------- cone: Python ----------
import Rhino.Geometry as rg

# Parameters
box_height = x
cone_height = 15*x
bottom_radius = x
top_radius = x / 2

# Position on top of the box
bottom_z = box_height
top_z = box_height + cone_height

# Create a closed truncated cone
profile = rg.Polyline([
    rg.Point3d(0, 0, bottom_z),
    rg.Point3d(bottom_radius, 0, bottom_z),
    rg.Point3d(top_radius, 0, top_z),
    rg.Point3d(0, 0, top_z),
    rg.Point3d(0, 0, bottom_z)
])

axis = rg.Line(
    rg.Point3d(0, 0, bottom_z),
    rg.Point3d(0, 0, top_z)
)

revolved = rg.RevSurface.Create(
    profile.ToNurbsCurve(), axis
)

a = revolved.ToBrep()
# ---------- end cone ----------
cube = Python3Script(x=x, offset=offset)  # -> out, a
# ---------- cube: Python ----------
import Rhino.Geometry as rg
import math

# Parameters from Grasshopper:
# x = base dimension
# offset = displacement of the hemisphere

height = x
width = 10 * x
depth = 10 * x

# Create the box
box = rg.Box(
    rg.Plane.WorldXY,
    rg.Interval(-width / 2, width / 2),
    rg.Interval(-depth / 2, depth / 2),
    rg.Interval(0, height)
)

a = box.ToBrep()

# Rotation depends on hemisphere offset
angle_degrees = offset * 9
angle_radians = math.radians(angle_degrees)

# Rotate around the vertical Z axis
rotation = rg.Transform.Rotation(
    angle_radians,
    rg.Vector3d.ZAxis,
    rg.Point3d(0, 0, 0)
)

a.Transform(rotation)
# ---------- end cube ----------
semisphere = Python3Script(x=x, y=radius, height=x, offset=offset)  # -> out, a
# ---------- semisphere: Python ----------
import Rhino.Geometry as rg
import math

cone_height = 15 * x
hemisphere_radius = x * 8

# Position at the tip of the cone
z = y + cone_height
center = rg.Point3d(offset, 0, z)

# Create a half-circle profile
arc = rg.Arc(
    rg.Point3d(offset + hemisphere_radius, 0, z),
    rg.Point3d(
        offset + hemisphere_radius / math.sqrt(2),
        0,
        z + hemisphere_radius / math.sqrt(2)
    ),
    rg.Point3d(offset, 0, z + hemisphere_radius)
)

# Revolve the arc around the vertical axis
axis = rg.Line(
    center,
    rg.Point3d(offset, 0, z + 1)
)


a = rg.RevSurface.Create(arc.ToNurbsCurve(), axis)
# ---------- end semisphere ----------
